# Dynamo graph 10-bar optimization through fully API.dyn "API" (Dynamo 2.17.0.3472)

code_block = CodeBlock()
# ---------- code_block.designscript (41 lines) ----------
["HSRO 3.5x.188",
"HSRO 3.5x.203",
"HSRO 3.5x.313",
"HSRO 4x.25",
"HSRO 4x.237",
"HSRO 4x.313",
"HSRO 4.5x.125",
"HSRO 4.5x.237",
"HSRO 4.5x.337",
"HSRO 4.5x.375",
"HSRO 5x.25",
"HSRO 5x.258",
"HSRO 5x.312",
"HSRO 5x.375",
"HSRO 5.563x.134",
"HSRO 5.563x.375",
"HSRO 6x.25",
"HSRO 6x.28",
"HSRO 6x.188",
"HSRO 6.625x.125",
"HSRO 6.625x.188",
"HSRO 6.875x.188",
"HSRO 6.875x.375",
"HSRO 7x.188",
"HSRO 7.5x.188",
"HSRO 7.625x.375",
"HSRO 9.625x.5",
"HSRO 9.625x.188",
"HSRO 10x.5",
"HSRO 10x.625",
"HSRO 12.75x.5",
"HSRO 14x.375",
"HSRO 16x.25",
"HSRO 16x.312",
"HSRO 16x.438",
"HSRO 16x.5",
"HSRO 16x.625",
"HSRO 18x.5",
"HSRO 18x.375",
"HSRO 20x.375",
"HSRO 20x.5"];
# ----------------------------------------
ga_penalty_method_as_cht = Python(IN[0]=code_block)  # CPython3; frozen
# ---------- ga_penalty_method_as_cht.python (297 lines) ----------
import clr  # Required for Python for .NET
import sys
import random
import sys
from io import StringIO
sys.stdout = StringIO()
clr.AddReference('ProtoGeometry')
from Autodesk.DesignScript.Geometry import *
import time
start_time = time.time()
# INPUTS

sections=IN[0]



# Load the RSA API library
clr.AddReference(r'D:\Programs\Autodesk\Revit2024\Robot Structural Analysis Professional 2024\Exe\interop.RobotOM.dll')

# Import the RSA API
from RobotOM import *
from System import Object

RobApp= RobotApplicationClass()


# Initialize the Robot application
RobApp.Project.Structure.Nodes.Create(1,0,0,0)
RobApp.Project.Structure.Nodes.Create(3,9.144,0,0)
RobApp.Project.Structure.Nodes.Create(2,0,0,9.144)
RobApp.Project.Structure.Nodes.Create(4,9.14,0,9.144)
RobApp.Project.Structure.Nodes.Create(5,18.288,0,9.144)
RobApp.Project.Structure.Nodes.Create(6,18.288,0,0)

RobApp.Project.Structure.Bars.Create(1,1,3)
RobApp.Project.Structure.Bars.Create(2,3,4)
RobApp.Project.Structure.Bars.Create(3,4,5)
RobApp.Project.Structure.Bars.Create(4,2,4)

RobApp.Project.Structure.Bars.Create(5,3,6)
RobApp.Project.Structure.Bars.Create(6,5,6)
RobApp.Project.Structure.Bars.Create(7,1,4)
RobApp.Project.Structure.Bars.Create(8,2,3)
RobApp.Project.Structure.Bars.Create(9,4,6)
RobApp.Project.Structure.Bars.Create(10,3,5)
	
# Retrieve a node and set its label
# with the 'SetLabel' method.
set_node1 = RobApp.Project.Structure.Nodes.Get(1)
set_node2 = RobApp.Project.Structure.Nodes.Get(2)



# Cast the COM object to the specific interface type
support1= IRobotNode(set_node1)
support2= IRobotNode(set_node2)


# Now you can call the 'SetLabel' method
support1.SetLabel(IRobotLabelType.I_LT_SUPPORT, "Pinned")
support2.SetLabel(IRobotLabelType.I_LT_SUPPORT, "Pinned")


# Create a new simple case
case_number = RobApp.Project.Structure.Cases.FreeNumber
cas = RobApp.Project.Structure.Cases.CreateSimple(case_number,"Case_1", IRobotCaseNature.I_CN_PERMANENT , IRobotCaseAnalizeType.I_CAT_STATIC_LINEAR)

cas2 = RobApp.Project.Structure.Cases.CreateSimple(case_number+1,"Case_2", IRobotCaseNature.I_CN_PERMANENT , IRobotCaseAnalizeType.I_CAT_STATIC_LINEAR)



case1=cas.Records.Create(IRobotLoadRecordType.I_LRT_NODE_FORCE)
case2=cas2.Records.Create(IRobotLoadRecordType.I_LRT_DEAD)


case11=RobotLoadRecord(case1)
case11.SetValue(IRobotNodeForceRecordValues.I_NFRV_FZ , -444822.16)

selection = case11.get_Objects()

a= IRobotSelection(selection)
a.FromText("3 6") 

case22=RobotLoadRecord(case2)
case22.SetValue(IRobotDeadRecordValues.I_DRV_Z,-1)
selection2 = case22.get_Objects()
b= IRobotSelection(selection2)
b.FromText("1to10") 
# List of section names


# Defining Material

# Define the material name
material_name = "10barsteel"


a=RobApp.Project.Structure.Labels
a=IRobotLabelServer(a)

a=a.Create(IRobotLabelType.I_LT_MATERIAL, material_name)

material = IRobotLabel(a).Data

material=IRobotMaterialData(material)


# Set the material properties
material.Type = IRobotMaterialType.I_MT_STEEL
material.E = 68947572932  # Young's modulus in Pascals
material.NU = 0.33    # Poisson's ratio
material.RO = 27679       # Unit weight in kg/m^3
material.Kirchoff = material.E / (2 * (1 + material.NU))

s=RobApp.Project.Structure.Labels.Store(a)



def myfunction(x):

    indexes = x
    section_names = [sections[i] for i in indexes]
    
    
    # Assign each section from the list to the corresponding bar
    for i, section_name in enumerate(section_names, start=1):
        # Retrieve the bar using its index
        bar = RobApp.Project.Structure.Bars.Get(i)
        
        # Cast the bar to the IRobotBar type
        bar = IRobotBar(bar)
        
        # Set the section label to the bar
        bar.SetLabel(IRobotLabelType.I_LT_BAR_SECTION, section_name)
        bar.SetLabel(IRobotLabelType.I_LT_MATERIAL ,"10barsteel"  )
        bar.SetLabel(IRobotLabelType.I_LT_BAR_RELEASE ,"Pinned-Pinned"  )
    
    
    a=RobApp.Project.get_CalcEngine()
    b=IRobotCalcEngine(a)
    b.Calculate()
    
    
    
    #RESULTS
    serv= RobApp.Project.Structure.Results.Nodes.Displacements
    serb= RobApp.Project.Structure.Results.Bars.Stresses
    serr = RobApp.Project.Structure.Results.Nodes.Reactions
    
    
    
    reactions=[]
    for i in range(1, 3):  
        data=serr.Value(i,2)
        
        b=IRobotReactionData(data)
        res_uz = b.FZ
        reactions.append(res_uz)
    
    displacements=[]
    for i in range(1, 7):  
        data=serv.Value(i,1)
        
        b=IRobotDisplacementData(data)
        res_uz = b.UZ
        displacements.append(res_uz)
        
    
    stresses=[]
    for i in range(1, 11):  
        data=serb.Value(i,1,1)
        
        b=IRobotBarStressData(data)
        FXSX  = b.FXSX 
        stresses.append(FXSX)
    
    #Convert to mm
    displacements = [num *1000 for num in displacements]
    
    #Convert to N/mm²
    stresses = [num / 1000000 for num in stresses]
    
    #Convert to kg
    reactions = sum(reactions)/9.81
    
    
    Save=RobApp.Kernel
    b=IRobotKernel(Save)
    b.ProjectSaveAs(r'C:\Users\ugury\OneDrive\Masaüstü\New folder\1.rtd')
    
    
    #WEIGHT SCORE EVALUATION
    #Actual stress in the bar
    stress=stresses
    Displacement=displacements
    weight=reactions
    
    #Sets the scoring system for the stress ratios
    TensAllowableStress=172.37
    CompAllowableStress=172.37
    AllowableDisplacement=50.8
    
    violation_coef=10
    
    tensstress=[]
    compstress=[]
    compindex=[]
    for index, value in enumerate(stress):
        if value < 0:
            compstress.append((value))
            compindex.append((index))
        else: 
            tensstress.append((value))    
    
    compstress=[abs(value) for value in compstress]
    
    Displacement=[abs(value) for value in Displacement]
    
    
    stress_ratio=[]
    violation = 0  # Initialize violation as a float or integer
    
    for i in tensstress:
        ratio = i / TensAllowableStress
        stress_ratio.append(ratio)
    
    
    for i in compstress:
        ratio = i / CompAllowableStress
        stress_ratio.append(ratio)
    
    
    for d in Displacement:
        ratio = d / AllowableDisplacement
        stress_ratio.append(ratio)
    
    for r in stress_ratio:
        if r - 1 > 0:
            violation += r - 1
    
    weight_score=weight*(1+(violation*violation_coef))

    return weight_score



import numpy as np
from pymoo.algorithms.soo.nonconvex.ga import GA
from pymoo.core.problem import Problem
from pymoo.operators.crossover.sbx import SBX
from pymoo.operators.mutation.pm import PM
from pymoo.operators.repair.rounding import RoundingRepair
from pymoo.operators.sampling.rnd import IntegerRandomSampling
from pymoo.optimize import minimize
import logging



class Problem(Problem):
    def __init__(self):
        super().__init__(n_var=10, 
                         n_obj=1,
                         xl=np.array([0]*10),  
                         xu=np.array([40]*10),
                         vtype=int)
            

    def _evaluate(self, x, out, *args, **kwargs):
        x=x.tolist() 
        weight_score= [myfunction(sublist) for sublist in x]  
        resutl=np.array(weight_score)
        out["F"] = np.array(weight_score)


problem = Problem()

algorithm = GA(pop_size=20,
               sampling=IntegerRandomSampling(),
               crossover=SBX(prob=1.0, eta=3.0, vtype=float,repair=RoundingRepair()),
               mutation=PM(prob=1.0, eta=3.0, vtype=float,repair=RoundingRepair()),
               eliminate_duplicates=True)

res = minimize(problem, algorithm,('n_gen', 20),verbose=True)

print("Best solution found:")
print("Variables:", res.X)
print("Objectives:", res.F)
print("Constraints:", res.CV)
print("Optimization result:", res.algorithm.result)
print("Execution time: {:.2f} seconds".format(time.time() - start_time))





sys.stdout.seek(0)
OUT = sys.stdout.read()
# ----------------------------------------
watch = Watch(ga_penalty_method_as_cht)
structure_create_with_imputs = Python(IN[0]=code_block)  # CPython3
# ---------- structure_create_with_imputs.python (262 lines) ----------
import clr  # Required for Python for .NET
import sys
import random
import sys
from io import StringIO
sys.stdout = StringIO()
clr.AddReference('ProtoGeometry')
from Autodesk.DesignScript.Geometry import *

# INPUTS

sections=IN[0]



# Load the RSA API library
clr.AddReference(r'D:\Programs\Autodesk\Revit2024\Robot Structural Analysis Professional 2024\Exe\interop.RobotOM.dll')

# Import the RSA API
from RobotOM import *
from System import Object

RobApp= RobotApplicationClass()


# Initialize the Robot application
RobApp.Project.Structure.Nodes.Create(1,0,0,0)
RobApp.Project.Structure.Nodes.Create(3,9.144,0,0)
RobApp.Project.Structure.Nodes.Create(2,0,0,9.144)
RobApp.Project.Structure.Nodes.Create(4,9.14,0,9.144)
RobApp.Project.Structure.Nodes.Create(5,18.288,0,9.144)
RobApp.Project.Structure.Nodes.Create(6,18.288,0,0)

RobApp.Project.Structure.Bars.Create(1,1,3)
RobApp.Project.Structure.Bars.Create(2,3,4)
RobApp.Project.Structure.Bars.Create(3,4,5)
RobApp.Project.Structure.Bars.Create(4,2,4)

RobApp.Project.Structure.Bars.Create(5,3,6)
RobApp.Project.Structure.Bars.Create(6,5,6)
RobApp.Project.Structure.Bars.Create(7,1,4)
RobApp.Project.Structure.Bars.Create(8,2,3)
RobApp.Project.Structure.Bars.Create(9,4,6)
RobApp.Project.Structure.Bars.Create(10,3,5)
	
# Retrieve a node and set its label
# with the 'SetLabel' method.
set_node1 = RobApp.Project.Structure.Nodes.Get(1)
set_node2 = RobApp.Project.Structure.Nodes.Get(2)



# Cast the COM object to the specific interface type
support1= IRobotNode(set_node1)
support2= IRobotNode(set_node2)


# Now you can call the 'SetLabel' method
support1.SetLabel(IRobotLabelType.I_LT_SUPPORT, "Pinned")
support2.SetLabel(IRobotLabelType.I_LT_SUPPORT, "Pinned")


# Create a new simple case
case_number = RobApp.Project.Structure.Cases.FreeNumber
cas = RobApp.Project.Structure.Cases.CreateSimple(case_number,"Case_1", IRobotCaseNature.I_CN_PERMANENT , IRobotCaseAnalizeType.I_CAT_STATIC_LINEAR)

cas2 = RobApp.Project.Structure.Cases.CreateSimple(case_number+1,"Case_2", IRobotCaseNature.I_CN_PERMANENT , IRobotCaseAnalizeType.I_CAT_STATIC_LINEAR)



case1=cas.Records.Create(IRobotLoadRecordType.I_LRT_NODE_FORCE)
case2=cas2.Records.Create(IRobotLoadRecordType.I_LRT_DEAD)


case11=RobotLoadRecord(case1)
case11.SetValue(IRobotNodeForceRecordValues.I_NFRV_FZ , -444822.16)

selection = case11.get_Objects()

a= IRobotSelection(selection)
a.FromText("3 6") 

case22=RobotLoadRecord(case2)
case22.SetValue(IRobotDeadRecordValues.I_DRV_Z,-1)
selection2 = case22.get_Objects()
b= IRobotSelection(selection2)
b.FromText("1to10") 
# List of section names


# Defining Material

# Define the material name
material_name = "10barsteel"


a=RobApp.Project.Structure.Labels
a=IRobotLabelServer(a)

a=a.Create(IRobotLabelType.I_LT_MATERIAL, material_name)

material = IRobotLabel(a).Data

material=IRobotMaterialData(material)


# Set the material properties
material.Type = IRobotMaterialType.I_MT_STEEL
material.E = 68947572932  # Young's modulus in Pascals
material.NU = 0.33    # Poisson's ratio
material.RO = 27679       # Unit weight in kg/m^3
material.Kirchoff = material.E / (2 * (1 + material.NU))

s=RobApp.Project.Structure.Labels.Store(a)



def myfunction(x):

    indexes = x
    section_names = [sections[i] for i in indexes]
    
    
    # Assign each section from the list to the corresponding bar
    for i, section_name in enumerate(section_names, start=1):
        # Retrieve the bar using its index
        bar = RobApp.Project.Structure.Bars.Get(i)
        
        # Cast the bar to the IRobotBar type
        bar = IRobotBar(bar)
        
        # Set the section label to the bar
        bar.SetLabel(IRobotLabelType.I_LT_BAR_SECTION, section_name)
        bar.SetLabel(IRobotLabelType.I_LT_MATERIAL ,"10barsteel"  )
        bar.SetLabel(IRobotLabelType.I_LT_BAR_RELEASE ,"Pinned-Pinned"  )
    
    
    a=RobApp.Project.get_CalcEngine()
    b=IRobotCalcEngine(a)
    b.Calculate()
    
    
    
    #RESULTS
    serv= RobApp.Project.Structure.Results.Nodes.Displacements
    serb= RobApp.Project.Structure.Results.Bars.Stresses
    serr = RobApp.Project.Structure.Results.Nodes.Reactions
    
    
    
    reactions=[]
    for i in range(1, 3):  
        data=serr.Value(i,2)
        
        b=IRobotReactionData(data)
        res_uz = b.FZ
        reactions.append(res_uz)
    
    displacements=[]
    for i in range(1, 7):  
        data=serv.Value(i,1)
        
        b=IRobotDisplacementData(data)
        res_uz = b.UZ
        displacements.append(res_uz)
        
    
    stresses=[]
    for i in range(1, 11):  
        data=serb.Value(i,1,1)
        
        b=IRobotBarStressData(data)
        FXSX  = b.FXSX 
        stresses.append(FXSX)
    
    #Convert to mm
    displacements = [num *1000 for num in displacements]
    
    #Convert to N/mm²
    stresses = [num / 1000000 for num in stresses]
    
    #Convert to kg
    reactions = sum(reactions)/9.81
    
    
    Save=RobApp.Kernel
    b=IRobotKernel(Save)
    b.ProjectSaveAs(r'C:\Users\ugury\OneDrive\Masaüstü\New folder\1.rtd')
    
    
    #WEIGHT SCORE EVALUATION
    #Actual stress in the bar
    stress=stresses
    Displacement=displacements
    weight=reactions
    
    #Sets the scoring system for the stress ratios
    TensAllowableStress=172.37
    CompAllowableStress=172.37
    AllowableDisplacement=50.8
    
    violation_coef=10
    
    tensstress=[]
    compstress=[]
    compindex=[]
    for index, value in enumerate(stress):
        if value < 0:
            compstress.append((value))
            compindex.append((index))
        else: 
            tensstress.append((value))    
    
    compstress=[abs(value) for value in compstress]
    
    Displacement=[abs(value) for value in Displacement]
    
    
    stress_ratio=[]
    violation = 0  # Initialize violation as a float or integer
    
    for i in tensstress:
        ratio = i / TensAllowableStress
        stress_ratio.append(ratio)
    
    
    for i in compstress:
        ratio = i / CompAllowableStress
        stress_ratio.append(ratio)
    
    
    for d in Displacement:
        ratio = d / AllowableDisplacement
        stress_ratio.append(ratio)
    
    for r in stress_ratio:
        if r - 1 > 0:
            violation += r - 1
    
    weight_score=weight*(1+(violation*violation_coef))

    return weight_score

import numpy as np



x=[40,  0, 14, 36, 29, 24, 29, 38, 38, 14]

x= [round(element) for element in x] 
weight_score= myfunction(x)  
resutl=np.array(weight_score)
print(resutl)







sys.stdout.seek(0)
OUT = sys.stdout.read()
# ----------------------------------------
pso_seperation_method_as_cht = Python(IN[0]=code_block)  # CPython3; frozen
# ---------- pso_seperation_method_as_cht.python (293 lines) ----------
import clr  # Required for Python for .NET
import sys
import random
import sys
from io import StringIO
sys.stdout = StringIO()
clr.AddReference('ProtoGeometry')
from Autodesk.DesignScript.Geometry import *
import time
start_time = time.time()
# INPUTS

sections=IN[0]



# Load the RSA API library
clr.AddReference(r'D:\Programs\Autodesk\Revit2024\Robot Structural Analysis Professional 2024\Exe\interop.RobotOM.dll')

# Import the RSA API
from RobotOM import *
from System import Object

RobApp= RobotApplicationClass()


# Initialize the Robot application
RobApp.Project.Structure.Nodes.Create(1,0,0,0)
RobApp.Project.Structure.Nodes.Create(3,9.144,0,0)
RobApp.Project.Structure.Nodes.Create(2,0,0,9.144)
RobApp.Project.Structure.Nodes.Create(4,9.14,0,9.144)
RobApp.Project.Structure.Nodes.Create(5,18.288,0,9.144)
RobApp.Project.Structure.Nodes.Create(6,18.288,0,0)

RobApp.Project.Structure.Bars.Create(1,1,3)
RobApp.Project.Structure.Bars.Create(2,3,4)
RobApp.Project.Structure.Bars.Create(3,4,5)
RobApp.Project.Structure.Bars.Create(4,2,4)

RobApp.Project.Structure.Bars.Create(5,3,6)
RobApp.Project.Structure.Bars.Create(6,5,6)
RobApp.Project.Structure.Bars.Create(7,1,4)
RobApp.Project.Structure.Bars.Create(8,2,3)
RobApp.Project.Structure.Bars.Create(9,4,6)
RobApp.Project.Structure.Bars.Create(10,3,5)
	
# Retrieve a node and set its label
# with the 'SetLabel' method.
set_node1 = RobApp.Project.Structure.Nodes.Get(1)
set_node2 = RobApp.Project.Structure.Nodes.Get(2)



# Cast the COM object to the specific interface type
support1= IRobotNode(set_node1)
support2= IRobotNode(set_node2)


# Now you can call the 'SetLabel' method
support1.SetLabel(IRobotLabelType.I_LT_SUPPORT, "Pinned")
support2.SetLabel(IRobotLabelType.I_LT_SUPPORT, "Pinned")


# Create a new simple case
case_number = RobApp.Project.Structure.Cases.FreeNumber
cas = RobApp.Project.Structure.Cases.CreateSimple(case_number,"Case_1", IRobotCaseNature.I_CN_PERMANENT , IRobotCaseAnalizeType.I_CAT_STATIC_LINEAR)

cas2 = RobApp.Project.Structure.Cases.CreateSimple(case_number+1,"Case_2", IRobotCaseNature.I_CN_PERMANENT , IRobotCaseAnalizeType.I_CAT_STATIC_LINEAR)



case1=cas.Records.Create(IRobotLoadRecordType.I_LRT_NODE_FORCE)
case2=cas2.Records.Create(IRobotLoadRecordType.I_LRT_DEAD)


case11=RobotLoadRecord(case1)
case11.SetValue(IRobotNodeForceRecordValues.I_NFRV_FZ , -444822.16)

selection = case11.get_Objects()

a= IRobotSelection(selection)
a.FromText("3 6") 

case22=RobotLoadRecord(case2)
case22.SetValue(IRobotDeadRecordValues.I_DRV_Z,-1)
selection2 = case22.get_Objects()
b= IRobotSelection(selection2)
b.FromText("1to10") 
# List of section names


# Defining Material

# Define the material name
material_name = "10barsteel"


a=RobApp.Project.Structure.Labels
a=IRobotLabelServer(a)

a=a.Create(IRobotLabelType.I_LT_MATERIAL, material_name)

material = IRobotLabel(a).Data

material=IRobotMaterialData(material)


# Set the material properties
material.Type = IRobotMaterialType.I_MT_STEEL
material.E = 68947572932  # Young's modulus in Pascals
material.NU = 0.33    # Poisson's ratio
material.RO = 27679       # Unit weight in kg/m^3
material.Kirchoff = material.E / (2 * (1 + material.NU))

s=RobApp.Project.Structure.Labels.Store(a)



def myfunction(x):

    indexes = x
    section_names = [sections[i] for i in indexes]
    
    
    # Assign each section from the list to the corresponding bar
    for i, section_name in enumerate(section_names, start=1):
        # Retrieve the bar using its index
        bar = RobApp.Project.Structure.Bars.Get(i)
        
        # Cast the bar to the IRobotBar type
        bar = IRobotBar(bar)
        
        # Set the section label to the bar
        bar.SetLabel(IRobotLabelType.I_LT_BAR_SECTION, section_name)
        bar.SetLabel(IRobotLabelType.I_LT_MATERIAL ,"10barsteel"  )
        bar.SetLabel(IRobotLabelType.I_LT_BAR_RELEASE ,"Pinned-Pinned"  )
    
    
    a=RobApp.Project.get_CalcEngine()
    b=IRobotCalcEngine(a)
    b.Calculate()
    
    
    
    #RESULTS
    serv= RobApp.Project.Structure.Results.Nodes.Displacements
    serb= RobApp.Project.Structure.Results.Bars.Stresses
    serr = RobApp.Project.Structure.Results.Nodes.Reactions
    
    
    
    reactions=[]
    for i in range(1, 3):  
        data=serr.Value(i,2)
        
        b=IRobotReactionData(data)
        res_uz = b.FZ
        reactions.append(res_uz)
    
    displacements=[]
    for i in range(1, 7):  
        data=serv.Value(i,1)
        
        b=IRobotDisplacementData(data)
        res_uz = b.UZ
        displacements.append(res_uz)
        
    
    stresses=[]
    for i in range(1, 11):  
        data=serb.Value(i,1,1)
        
        b=IRobotBarStressData(data)
        FXSX  = b.FXSX 
        stresses.append(FXSX)
    
    #Convert to mm
    displacements = [num *1000 for num in displacements]
    
    #Convert to N/mm²
    stresses = [num / 1000000 for num in stresses]
    
    #Convert to kg
    reactions = sum(reactions)/9.81
    
    
    Save=RobApp.Kernel
    b=IRobotKernel(Save)
    b.ProjectSaveAs(r'C:\Users\ugury\OneDrive\Masaüstü\New folder\1.rtd')
    
    
    #WEIGHT SCORE EVALUATION
    #Actual stress in the bar
    stress=stresses
    Displacement=displacements
    weight=reactions
    
    #Sets the scoring system for the stress ratios
    TensAllowableStress=172.37
    CompAllowableStress=172.37
    AllowableDisplacement=50.8
    
    violation_coef=10
    
    tensstress=[]
    compstress=[]
    compindex=[]
    for index, value in enumerate(stress):
        if value < 0:
            compstress.append((value))
            compindex.append((index))
        else: 
            tensstress.append((value))    
    
    compstress=[abs(value) for value in compstress]
    
    Displacement=[abs(value) for value in Displacement]
    
    
    stress_ratio=[]
    violation = 0  # Initialize violation as a float or integer
    
    for i in tensstress:
        ratio = i / TensAllowableStress
        stress_ratio.append(ratio)
    
    
    for i in compstress:
        ratio = i / CompAllowableStress
        stress_ratio.append(ratio)
    
    
    for d in Displacement:
        ratio = d / AllowableDisplacement
        stress_ratio.append(ratio)
    
    for r in stress_ratio:
        if r - 1 > 0:
            violation += r - 1
    
    weight_score=weight*(1+(violation*violation_coef))

    return weight_score


import numpy as np
from pymoo.algorithms.soo.nonconvex.ga import GA
from pymoo.algorithms.moo.nsga2 import NSGA2
from pymoo.core.problem import Problem
from pymoo.core.callback import Callback
from pymoo.optimize import minimize
import logging
from pymoo.algorithms.soo.nonconvex.pso import PSO
from pymoo.operators.repair.rounding import RoundingRepair


class Problem(Problem):
    def __init__(self):
        super().__init__(n_var=10, 
                         n_obj=1,
                         xl=np.array([0]*10),  
                         xu=np.array([40]*10),
                         vtype=int)
            

    def _evaluate(self, x, out, *args, **kwargs):
        x=x.tolist() 
        x= [[round(element) for element in sublist] for sublist in x]
        weight_score= [myfunction(sublist) for sublist in x]  
        resutl=np.array(weight_score)
        out["F"] = np.array(weight_score)


problem = Problem()

algorithm = PSO(pop_size=20,adaptive=True)

res = minimize(problem, algorithm,('n_gen', 20), verbose=True)

print("Best solution found:")
print("Variables:", res.X)
print("Objectives:", res.F)
print("Constraints:", res.CV)
print("Optimization result:", res.algorithm.result)

print("Execution time: {:.2f} seconds".format(time.time() - start_time))





sys.stdout.seek(0)
OUT = sys.stdout.read()
# ----------------------------------------
watch_2 = Watch(pso_seperation_method_as_cht)
ga_seperation_method_as_cht = Python(IN[0]=code_block)  # CPython3; frozen
# ---------- ga_seperation_method_as_cht.python (297 lines) ----------
import clr  # Required for Python for .NET
import sys
import random
import sys
from io import StringIO
sys.stdout = StringIO()
clr.AddReference('ProtoGeometry')
from Autodesk.DesignScript.Geometry import *
import time
start_time = time.time()
# INPUTS

sections=IN[0]



# Load the RSA API library
clr.AddReference(r'D:\Programs\Autodesk\Revit2024\Robot Structural Analysis Professional 2024\Exe\interop.RobotOM.dll')

# Import the RSA API
from RobotOM import *
from System import Object

RobApp= RobotApplicationClass()


# Initialize the Robot application
RobApp.Project.Structure.Nodes.Create(1,0,0,0)
RobApp.Project.Structure.Nodes.Create(3,9.144,0,0)
RobApp.Project.Structure.Nodes.Create(2,0,0,9.144)
RobApp.Project.Structure.Nodes.Create(4,9.14,0,9.144)
RobApp.Project.Structure.Nodes.Create(5,18.288,0,9.144)
RobApp.Project.Structure.Nodes.Create(6,18.288,0,0)

RobApp.Project.Structure.Bars.Create(1,1,3)
RobApp.Project.Structure.Bars.Create(2,3,4)
RobApp.Project.Structure.Bars.Create(3,4,5)
RobApp.Project.Structure.Bars.Create(4,2,4)

RobApp.Project.Structure.Bars.Create(5,3,6)
RobApp.Project.Structure.Bars.Create(6,5,6)
RobApp.Project.Structure.Bars.Create(7,1,4)
RobApp.Project.Structure.Bars.Create(8,2,3)
RobApp.Project.Structure.Bars.Create(9,4,6)
RobApp.Project.Structure.Bars.Create(10,3,5)
	
# Retrieve a node and set its label
# with the 'SetLabel' method.
set_node1 = RobApp.Project.Structure.Nodes.Get(1)
set_node2 = RobApp.Project.Structure.Nodes.Get(2)



# Cast the COM object to the specific interface type
support1= IRobotNode(set_node1)
support2= IRobotNode(set_node2)


# Now you can call the 'SetLabel' method
support1.SetLabel(IRobotLabelType.I_LT_SUPPORT, "Pinned")
support2.SetLabel(IRobotLabelType.I_LT_SUPPORT, "Pinned")


# Create a new simple case
case_number = RobApp.Project.Structure.Cases.FreeNumber
cas = RobApp.Project.Structure.Cases.CreateSimple(case_number,"Case_1", IRobotCaseNature.I_CN_PERMANENT , IRobotCaseAnalizeType.I_CAT_STATIC_LINEAR)

cas2 = RobApp.Project.Structure.Cases.CreateSimple(case_number+1,"Case_2", IRobotCaseNature.I_CN_PERMANENT , IRobotCaseAnalizeType.I_CAT_STATIC_LINEAR)



case1=cas.Records.Create(IRobotLoadRecordType.I_LRT_NODE_FORCE)
case2=cas2.Records.Create(IRobotLoadRecordType.I_LRT_DEAD)


case11=RobotLoadRecord(case1)
case11.SetValue(IRobotNodeForceRecordValues.I_NFRV_FZ , -444822.16)

selection = case11.get_Objects()

a= IRobotSelection(selection)
a.FromText("3 6") 

case22=RobotLoadRecord(case2)
case22.SetValue(IRobotDeadRecordValues.I_DRV_Z,-1)
selection2 = case22.get_Objects()
b= IRobotSelection(selection2)
b.FromText("1to10") 
# List of section names


# Defining Material

# Define the material name
material_name = "10barsteel"


a=RobApp.Project.Structure.Labels
a=IRobotLabelServer(a)

a=a.Create(IRobotLabelType.I_LT_MATERIAL, material_name)

material = IRobotLabel(a).Data

material=IRobotMaterialData(material)


# Set the material properties
material.Type = IRobotMaterialType.I_MT_STEEL
material.E = 68947572932  # Young's modulus in Pascals
material.NU = 0.33    # Poisson's ratio
material.RO = 27679       # Unit weight in kg/m^3
material.Kirchoff = material.E / (2 * (1 + material.NU))

s=RobApp.Project.Structure.Labels.Store(a)



def myfunction(x):

    indexes = x
    section_names = [sections[i] for i in indexes]
    
    
    # Assign each section from the list to the corresponding bar
    for i, section_name in enumerate(section_names, start=1):
        # Retrieve the bar using its index
        bar = RobApp.Project.Structure.Bars.Get(i)
        
        # Cast the bar to the IRobotBar type
        bar = IRobotBar(bar)
        
        # Set the section label to the bar
        bar.SetLabel(IRobotLabelType.I_LT_BAR_SECTION, section_name)
        bar.SetLabel(IRobotLabelType.I_LT_MATERIAL ,"10barsteel"  )
        bar.SetLabel(IRobotLabelType.I_LT_BAR_RELEASE ,"Pinned-Pinned"  )
    
    
    a=RobApp.Project.get_CalcEngine()
    b=IRobotCalcEngine(a)
    b.Calculate()
    
    
    
    #RESULTS
    serv= RobApp.Project.Structure.Results.Nodes.Displacements
    serb= RobApp.Project.Structure.Results.Bars.Stresses
    serr = RobApp.Project.Structure.Results.Nodes.Reactions
    
    
    
    reactions=[]
    for i in range(1, 3):  
        data=serr.Value(i,2)
        
        b=IRobotReactionData(data)
        res_uz = b.FZ
        reactions.append(res_uz)
    
    displacements=[]
    for i in range(1, 7):  
        data=serv.Value(i,1)
        
        b=IRobotDisplacementData(data)
        res_uz = b.UZ
        displacements.append(res_uz)
        
    
    stresses=[]
    for i in range(1, 11):  
        data=serb.Value(i,1,1)
        
        b=IRobotBarStressData(data)
        FXSX  = b.FXSX 
        stresses.append(FXSX)
    
    #Convert to mm
    displacements = [num *1000 for num in displacements]
    
    #Convert to N/mm²
    stresses = [num / 1000000 for num in stresses]
    
    #Convert to kg
    reactions = sum(reactions)/9.81
    
    
    Save=RobApp.Kernel
    b=IRobotKernel(Save)
    b.ProjectSaveAs(r'C:\Users\ugury\OneDrive\Masaüstü\New folder\1.rtd')
    
    
    #WEIGHT SCORE EVALUATION
    #Actual stress in the bar
    stress=stresses
    Displacement=displacements
    weight=reactions
    
    #Sets the scoring system for the stress ratios
    TensAllowableStress=172.37
    CompAllowableStress=172.37
    AllowableDisplacement=50.8
    
    violation_coef=10
    
    tensstress=[]
    compstress=[]
    compindex=[]
    for index, value in enumerate(stress):
        if value < 0:
            compstress.append((value))
            compindex.append((index))
        else: 
            tensstress.append((value))    
    
    compstress=[abs(value) for value in compstress]
    
    Displacement=[abs(value) for value in Displacement]
    
    
    stress_ratio=[]
    violation = 0  # Initialize violation as a float or integer
    
    for i in tensstress:
        ratio = i / TensAllowableStress
        stress_ratio.append(ratio)
    
    
    for i in compstress:
        ratio = i / CompAllowableStress
        stress_ratio.append(ratio)
    
    
    for d in Displacement:
        ratio = d / AllowableDisplacement
        stress_ratio.append(ratio)
    
    for r in stress_ratio:
        if r - 1 > 0:
            violation += r - 1


    return violation, weight



import numpy as np
from pymoo.algorithms.soo.nonconvex.ga import GA
from pymoo.core.problem import Problem
from pymoo.operators.crossover.sbx import SBX
from pymoo.operators.mutation.pm import PM
from pymoo.operators.repair.rounding import RoundingRepair
from pymoo.operators.sampling.rnd import IntegerRandomSampling
from pymoo.optimize import minimize
import logging
from pymoo.constraints.eps import AdaptiveEpsilonConstraintHandling


class Problem(Problem):
    def __init__(self):
        super().__init__(n_var=10, 
                         n_obj=1,
                         n_ieq_constr=1, n_eq_constr=0,
                         xl=np.array([0]*10),  
                         xu=np.array([40]*10),
                         vtype=int)
            

    def _evaluate(self, x, out, *args, **kwargs):
        x=x.tolist() 
        weight_score= [myfunction(sublist) for sublist in x]  
        G,F=zip(*weight_score)
        out["F"] = np.array(F)
        out["G"] = np.array(G)


problem = Problem()

algorithm = AdaptiveEpsilonConstraintHandling(GA(pop_size=20,
               sampling=IntegerRandomSampling(),
               crossover=SBX(prob=1.0, eta=3.0, vtype=float,repair=RoundingRepair()),
               mutation=PM(prob=1.0, eta=3.0, vtype=float,repair=RoundingRepair()),
               eliminate_duplicates=True),perc_eps_until=0.5)

res = minimize(problem, algorithm,('n_gen', 20),verbose=True)

print("Best solution found:")
print("Variables:", res.X)
print("Objectives:", res.F)
print("Constraints:", res.CV)
print("Optimization result:", res.algorithm.result)
print("Execution time: {:.2f} seconds".format(time.time() - start_time))




sys.stdout.seek(0)
OUT = sys.stdout.read()
# ----------------------------------------
watch_3 = Watch(ga_seperation_method_as_cht)
pso_penalty_method_as_cht = Python(IN[0]=code_block)  # CPython3; frozen
# ---------- pso_penalty_method_as_cht.python (300 lines) ----------
import clr  # Required for Python for .NET
import sys
import random
import sys
from io import StringIO
sys.stdout = StringIO()
clr.AddReference('ProtoGeometry')
from Autodesk.DesignScript.Geometry import *
import time
start_time = time.time()
# INPUTS

sections=IN[0]



# Load the RSA API library
clr.AddReference(r'D:\Programs\Autodesk\Revit2024\Robot Structural Analysis Professional 2024\Exe\interop.RobotOM.dll')

# Import the RSA API
from RobotOM import *
from System import Object

RobApp= RobotApplicationClass()


# Initialize the Robot application
RobApp.Project.Structure.Nodes.Create(1,0,0,0)
RobApp.Project.Structure.Nodes.Create(3,9.144,0,0)
RobApp.Project.Structure.Nodes.Create(2,0,0,9.144)
RobApp.Project.Structure.Nodes.Create(4,9.14,0,9.144)
RobApp.Project.Structure.Nodes.Create(5,18.288,0,9.144)
RobApp.Project.Structure.Nodes.Create(6,18.288,0,0)

RobApp.Project.Structure.Bars.Create(1,1,3)
RobApp.Project.Structure.Bars.Create(2,3,4)
RobApp.Project.Structure.Bars.Create(3,4,5)
RobApp.Project.Structure.Bars.Create(4,2,4)

RobApp.Project.Structure.Bars.Create(5,3,6)
RobApp.Project.Structure.Bars.Create(6,5,6)
RobApp.Project.Structure.Bars.Create(7,1,4)
RobApp.Project.Structure.Bars.Create(8,2,3)
RobApp.Project.Structure.Bars.Create(9,4,6)
RobApp.Project.Structure.Bars.Create(10,3,5)
	
# Retrieve a node and set its label
# with the 'SetLabel' method.
set_node1 = RobApp.Project.Structure.Nodes.Get(1)
set_node2 = RobApp.Project.Structure.Nodes.Get(2)



# Cast the COM object to the specific interface type
support1= IRobotNode(set_node1)
support2= IRobotNode(set_node2)


# Now you can call the 'SetLabel' method
support1.SetLabel(IRobotLabelType.I_LT_SUPPORT, "Pinned")
support2.SetLabel(IRobotLabelType.I_LT_SUPPORT, "Pinned")


# Create a new simple case
case_number = RobApp.Project.Structure.Cases.FreeNumber
cas = RobApp.Project.Structure.Cases.CreateSimple(case_number,"Case_1", IRobotCaseNature.I_CN_PERMANENT , IRobotCaseAnalizeType.I_CAT_STATIC_LINEAR)

cas2 = RobApp.Project.Structure.Cases.CreateSimple(case_number+1,"Case_2", IRobotCaseNature.I_CN_PERMANENT , IRobotCaseAnalizeType.I_CAT_STATIC_LINEAR)



case1=cas.Records.Create(IRobotLoadRecordType.I_LRT_NODE_FORCE)
case2=cas2.Records.Create(IRobotLoadRecordType.I_LRT_DEAD)


case11=RobotLoadRecord(case1)
case11.SetValue(IRobotNodeForceRecordValues.I_NFRV_FZ , -444822.16)

selection = case11.get_Objects()

a= IRobotSelection(selection)
a.FromText("3 6") 

case22=RobotLoadRecord(case2)
case22.SetValue(IRobotDeadRecordValues.I_DRV_Z,-1)
selection2 = case22.get_Objects()
b= IRobotSelection(selection2)
b.FromText("1to10") 
# List of section names


# Defining Material

# Define the material name
material_name = "10barsteel"


a=RobApp.Project.Structure.Labels
a=IRobotLabelServer(a)

a=a.Create(IRobotLabelType.I_LT_MATERIAL, material_name)

material = IRobotLabel(a).Data

material=IRobotMaterialData(material)


# Set the material properties
material.Type = IRobotMaterialType.I_MT_STEEL
material.E = 68947572932  # Young's modulus in Pascals
material.NU = 0.33    # Poisson's ratio
material.RO = 27679       # Unit weight in kg/m^3
material.Kirchoff = material.E / (2 * (1 + material.NU))

s=RobApp.Project.Structure.Labels.Store(a)



def myfunction(x):

    indexes = x
    section_names = [sections[i] for i in indexes]
    
    
    # Assign each section from the list to the corresponding bar
    for i, section_name in enumerate(section_names, start=1):
        # Retrieve the bar using its index
        bar = RobApp.Project.Structure.Bars.Get(i)
        
        # Cast the bar to the IRobotBar type
        bar = IRobotBar(bar)
        
        # Set the section label to the bar
        bar.SetLabel(IRobotLabelType.I_LT_BAR_SECTION, section_name)
        bar.SetLabel(IRobotLabelType.I_LT_MATERIAL ,"10barsteel"  )
        bar.SetLabel(IRobotLabelType.I_LT_BAR_RELEASE ,"Pinned-Pinned"  )
    
    
    a=RobApp.Project.get_CalcEngine()
    b=IRobotCalcEngine(a)
    b.Calculate()
    
    
    
    #RESULTS
    serv= RobApp.Project.Structure.Results.Nodes.Displacements
    serb= RobApp.Project.Structure.Results.Bars.Stresses
    serr = RobApp.Project.Structure.Results.Nodes.Reactions
    
    
    
    reactions=[]
    for i in range(1, 3):  
        data=serr.Value(i,2)
        
        b=IRobotReactionData(data)
        res_uz = b.FZ
        reactions.append(res_uz)
    
    displacements=[]
    for i in range(1, 7):  
        data=serv.Value(i,1)
        
        b=IRobotDisplacementData(data)
        res_uz = b.UZ
        displacements.append(res_uz)
        
    
    stresses=[]
    for i in range(1, 11):  
        data=serb.Value(i,1,1)
        
        b=IRobotBarStressData(data)
        FXSX  = b.FXSX 
        stresses.append(FXSX)
    
    #Convert to mm
    displacements = [num *1000 for num in displacements]
    
    #Convert to N/mm²
    stresses = [num / 1000000 for num in stresses]
    
    #Convert to kg
    reactions = sum(reactions)/9.81
    
    
    Save=RobApp.Kernel
    b=IRobotKernel(Save)
    b.ProjectSaveAs(r'C:\Users\ugury\OneDrive\Masaüstü\New folder\1.rtd')
    
    
    #WEIGHT SCORE EVALUATION
    #Actual stress in the bar
    stress=stresses
    Displacement=displacements
    weight=reactions
    
    #Sets the scoring system for the stress ratios
    TensAllowableStress=172.37
    CompAllowableStress=172.37
    AllowableDisplacement=50.8
    
    violation_coef=10
    
    tensstress=[]
    compstress=[]
    compindex=[]
    for index, value in enumerate(stress):
        if value < 0:
            compstress.append((value))
            compindex.append((index))
        else: 
            tensstress.append((value))    
    
    compstress=[abs(value) for value in compstress]
    
    Displacement=[abs(value) for value in Displacement]
    
    
    stress_ratio=[]
    violation = 0  # Initialize violation as a float or integer
    
    for i in tensstress:
        ratio = i / TensAllowableStress
        stress_ratio.append(ratio)
    
    
    for i in compstress:
        ratio = i / CompAllowableStress
        stress_ratio.append(ratio)
    
    
    for d in Displacement:
        ratio = d / AllowableDisplacement
        stress_ratio.append(ratio)
    
    for r in stress_ratio:
        if r - 1 > 0:
            violation += r - 1
    
    weight_score=weight*(1+(violation*violation_coef))

    return  violation, weight



import numpy as np
from pymoo.algorithms.soo.nonconvex.ga import GA
from pymoo.algorithms.moo.nsga2 import NSGA2
from pymoo.core.problem import Problem
from pymoo.core.callback import Callback
from pymoo.optimize import minimize
import logging
from pymoo.algorithms.soo.nonconvex.pso import PSO
from pymoo.operators.repair.rounding import RoundingRepair
from pymoo.constraints.eps import AdaptiveEpsilonConstraintHandling
from pymoo.operators.sampling.rnd import IntegerRandomSampling

class Problem(Problem):
    def __init__(self):
        super().__init__(n_var=10, 
                         n_obj=1,
                         n_ieq_constr=1, n_eq_constr=0,
                         xl=np.array([0]*10),  
                         xu=np.array([40]*10),
                         vtype=int)
            

    def _evaluate(self, x, out, *args, **kwargs):
        x=x.tolist() 
        x= [[round(element) for element in sublist] for sublist in x]        
        weight_score= [myfunction(sublist) for sublist in x]  
        G,F=zip(*weight_score)
        out["F"] = np.array(F)
        out["G"] = np.array(G)


problem = Problem()

algorithm = PSO(pop_size=20,adaptive=True)

res = minimize(AdaptiveEpsilonConstraintHandling(problem, perc_eps_until=0.5),
               algorithm,
               ('n_gen', 20),
               verbose=True)

print("Best solution found:")
print("Variables:", res.X)
print("Objectives:", res.F)
print("Constraints:", res.CV)
print("Optimization result:", res.algorithm.result)

print("Execution time: {:.2f} seconds".format(time.time() - start_time))





sys.stdout.seek(0)
OUT = sys.stdout.read()
# ----------------------------------------
watch_4 = Watch(pso_penalty_method_as_cht)
