# Dynamo graph 120-bar Dome API with buckling.dyn "120 API TEST" (Dynamo 2.17.0.3472)

code_block = CodeBlock { point1 = Point.ByCoordinates(0, 0, 5); point2 = Point.ByCoordinates(0, 0, 2); point3 = Point.ByCoordinates(0, 0, 0); }
list_create = List.Create(item0=code_block.point1, item1=code_block.point2, item2=code_block.point3)

# group: Geometry config
code_block_2 = CodeBlock { [6.941,12.5,15.89]; }
byCenterPointRadius = Circle.ByCenterPointRadius(centerPoint=list_create, radius=code_block_2)
code_block_3 = CodeBlock { 12; }
regularPolygon = Polygon.RegularPolygon(circle=byCenterPointRadius, numberSides=code_block_3)
explode = Geometry.Explode(geometry=regularPolygon)
pointAtParameter = Curve.PointAtParameter(curve=explode)
code_block_4 = CodeBlock { 7; }
byCoordinates = Point.ByCoordinates(z=code_block_4)

# group: Group 4
code_block_5 = CodeBlock(lst=explode) { lst[1]; }
code_block_6 = CodeBlock(lst=pointAtParameter) { lst[0]; }
firstItem = List.FirstItem(list=code_block_6)
list_create_2 = List.Create()  # unwired: item0, item1
code_block_7 = CodeBlock { 0.5; }
pointAtParameter_2 = Curve.PointAtParameter(curve=code_block_5, param=code_block_7)
combine = List.Combine(combineFunction=list_create_2, list0=code_block_6, list1=pointAtParameter_2)
addItemToEnd = List.AddItemToEnd(item=firstItem, list=combine)
flatten = List.Flatten(list=addItemToEnd)
byPoints = PolyCurve.ByPoints(points=flatten)
explode_2 = Geometry.Explode(geometry=byPoints)

# group: Group 7
code_block_8 = CodeBlock { 0.5; }
code_block_9 = CodeBlock(lst=pointAtParameter) { lst[2]; }
firstItem_2 = List.FirstItem(list=code_block_9)
list_create_3 = List.Create()  # unwired: item0, item1
pointAtParameter_3 = Curve.PointAtParameter(curve=code_block_5, param=code_block_8)
combine_2 = List.Combine(combineFunction=list_create_3, list0=code_block_9, list1=pointAtParameter_3)
addItemToEnd_2 = List.AddItemToEnd(item=firstItem_2, list=combine_2)
flatten_2 = List.Flatten(list=addItemToEnd_2)
byPoints_2 = PolyCurve.ByPoints(points=flatten_2)
explode_3 = Geometry.Explode(geometry=byPoints_2)

# group: Group 5
code_block_10 = CodeBlock(lst=pointAtParameter) { lst[1]; }
pointAtParameter_4 = Curve.PointAtParameter(curve=code_block_5, param=code_block_8)
list_create_4 = List.Create(item0=code_block_10, item1=pointAtParameter_4)
firstItem_3 = List.FirstItem(list=code_block_10)
list_create_5 = List.Create()  # unwired: item0, item1
combine_3 = List.Combine(combineFunction=list_create_5, list0=code_block_10, list1=pointAtParameter_4)
addItemToEnd_3 = List.AddItemToEnd(item=firstItem_3, list=combine_3)
flatten_3 = List.Flatten(list=addItemToEnd_3)
byPoints_3 = PolyCurve.ByPoints(points=flatten_3)
explode_4 = Geometry.Explode(geometry=byPoints_3)

# group: Group 1
code_block_11 = CodeBlock(lst=pointAtParameter) { lst[0]; }
byStartPointEndPoint = Line.ByStartPointEndPoint(startPoint=byCoordinates, endPoint=code_block_11)

# group: Group 2
code_block_12 = CodeBlock(lst=explode) { lst[0]; }

# group: Group 3
code_block_13 = CodeBlock(lst=pointAtParameter) { lst[0]; lst[1]; }
byStartPointEndPoint_2 = Line.ByStartPointEndPoint(startPoint=code_block_13.out0, endPoint=code_block_13.out1)

# group: Group 6
code_block_14 = CodeBlock(lst=pointAtParameter) { lst[1]; lst[2]; }
byStartPointEndPoint_3 = Line.ByStartPointEndPoint(startPoint=code_block_14.out0, endPoint=code_block_14.out1)

# group: INPUTS
sections = CodeBlock()
# ---------- sections.designscript (27 lines) ----------
["CHS 33.7x3",
"CHS 42.4x3",
"CHS 48.3x3",
"CHS 60.3x3",
"CHS 76.1x3",
"CHS 60.3x4",
"CHS 88.9x3",
"CHS 76.1x4",
"CHS 114.3x3",
"CHS 88.9x4",
"CHS 88.9x5",
"CHS 114.3x4",
"CHS 88.9x6.3",
"CHS 114.3x5",
"CHS 114.3x6",
"CHS 139.7x5",
"CHS 139.7x6",
"CHS 139.7x6.3",
"CHS 193.7x5",
"CHS 168.3x6",
"CHS 219.1x5",
"CHS 193.7x6.3",
"CHS 219.1x6.3",
"CHS 244.5x6.3",
"CHS 219.1x8",
"CHS 219.1x10",
"CHS 406.4x6.3"];
# ----------------------------------------
elements = List.Create(item0=byStartPointEndPoint, item1=code_block_12, item2=byStartPointEndPoint_2, item3=explode_2, item4=explode_4, item5=byStartPointEndPoint_3, item6=explode_3)
flatten_4 = List.Flatten(list=elements)
count = List.Count(list=elements@L2)

# group: Slenderness
radius_of_gyration = CodeBlock()
# ---------- radius_of_gyration.designscript (27 lines) ----------
[10.9,
14,
16.1,
20.3,
25.9,
20,
30.4,
25.5,
39.4,
30,
29.7,
39,
29.3,
38.7,
38.3,
47.7,
47.3,
47.2,
66.7,
57.4,
75.7,
66.3,
75.3,
84.2,
74.7,
74,
141];
# ----------------------------------------
startPoint = Curve.StartPoint(curve=flatten_4)
endPoint = Curve.EndPoint(curve=flatten_4)
distanceTo = Geometry.DistanceTo(geometry=startPoint, other=endPoint)
code_block_15 = CodeBlock(x=distanceTo) { x*1000; }

structure_create_on_rsa_with = Python(IN[0]=sections, IN[1]=flatten_4, IN[2]=count, IN[3]=radius_of_gyration, IN[4]=code_block_15)  # "Structure create on RSA with inputs"; CPython3; frozen
# ---------- structure_create_on_rsa_with.python (339 lines) ----------
import clr  # Required for Python for .NET
import sys
import random
import sys
import math
from io import StringIO
sys.stdout = StringIO()
clr.AddReference('ProtoGeometry')

from Autodesk.DesignScript.Geometry import *
import time
start_time = time.time()

# INPUTS

sections=IN[0]
bars=IN[1]
groups=IN[2]
gr_list=IN[3]



# Load the RSA API library
clr.AddReference(r'D:\Programs\Autodesk\Revit2024\Robot Structural Analysis Professional 2024\Exe\interop.RobotOM.dll')

# Import the RSA API
from RobotOM import *
from System import Object

RobApp= RobotApplicationClass()

## Dictionary to map unique nodes to their assigned IDs
unique_nodes = {}
next_node_id = 1  # Start with the first ID for nodes
next_bar_id = 1  # Start with the first ID for bars

def round_coords(x, y, z, precision=4):
    return (round(x, precision), round(y, precision), round(z, precision))

# Assign an ID to each unique node
for bar in bars:
    start_key = round_coords(bar.StartPoint.X, bar.StartPoint.Y, bar.StartPoint.Z)
    end_key = round_coords(bar.EndPoint.X, bar.EndPoint.Y, bar.EndPoint.Z)

    # If the start node is unique, assign an ID
    if start_key not in unique_nodes:
        unique_nodes[start_key] = next_node_id
        next_node_id += 1

    # If the end node is unique, assign an ID
    if end_key not in unique_nodes:
        unique_nodes[end_key] = next_node_id
        next_node_id += 1

# Now create nodes and bars in RSA
for bar in bars:
    start_key = round_coords(bar.StartPoint.X, bar.StartPoint.Y, bar.StartPoint.Z)
    end_key = round_coords(bar.EndPoint.X, bar.EndPoint.Y, bar.EndPoint.Z)

    # Retrieve the pre-assigned node IDs
    start_node_id = unique_nodes[start_key]
    end_node_id = unique_nodes[end_key]

    # Create the nodes with the assigned IDs
    RobApp.Project.Structure.Nodes.Create(start_node_id, *start_key)
    RobApp.Project.Structure.Nodes.Create(end_node_id, *end_key)

    # Create the bar between the nodes
    RobApp.Project.Structure.Bars.Create(next_bar_id, start_node_id, end_node_id)
    next_bar_id += 1  # Increment the bar ID for the next creation


support_list = [i for i in range(38, 50)]

for i in support_list:

    set_node1 = RobApp.Project.Structure.Nodes.Get(i)
    support1= IRobotNode(set_node1)
    support1.SetLabel(IRobotLabelType.I_LT_SUPPORT, "Pinned")
    
# Create a new simple case
case_number = RobApp.Project.Structure.Cases.FreeNumber
cas = RobApp.Project.Structure.Cases.CreateSimple(case_number,"Case_1", IRobotCaseNature.I_CN_PERMANENT , IRobotCaseAnalizeType.I_CAT_STATIC_LINEAR )

cas2 = RobApp.Project.Structure.Cases.CreateSimple(case_number+1,"Case_2", IRobotCaseNature.I_CN_PERMANENT , IRobotCaseAnalizeType.I_CAT_STATIC_LINEAR )



case1=cas.Records.Create(IRobotLoadRecordType.I_LRT_NODE_FORCE)
case2=cas2.Records.Create(IRobotLoadRecordType.I_LRT_DEAD)

# Point weight
load1=RobotLoadRecord(cas.Records.Create(IRobotLoadRecordType.I_LRT_NODE_FORCE))
load1.SetValue(IRobotNodeForceRecordValues.I_NFRV_FZ , -60000)
selection = load1.get_Objects()
a= IRobotSelection(selection)
a.FromText("1") 


load2=RobotLoadRecord(cas.Records.Create(IRobotLoadRecordType.I_LRT_NODE_FORCE))
load2.SetValue(IRobotNodeForceRecordValues.I_NFRV_FZ , -30000)
selection = load2.get_Objects()
b= IRobotSelection(selection)
b.FromText("2to13") 


load3=RobotLoadRecord(case1)
load3.SetValue(IRobotNodeForceRecordValues.I_NFRV_FZ , -10000)
selection = load3.get_Objects()
c= IRobotSelection(selection)
c.FromText("14to25") 



# Selfweight
case22=RobotLoadRecord(case2)
case22.SetValue(IRobotDeadRecordValues.I_DRV_Z,-1)
selection2 = case22.get_Objects()
b= IRobotSelection(selection2)
b.FromText("1to120") 


# Defining Material

# Define the material name
material_name = "120bar"


a=RobApp.Project.Structure.Labels
a=IRobotLabelServer(a)

a=a.Create(IRobotLabelType.I_LT_MATERIAL, material_name)

material = IRobotLabel(a).Data

material=IRobotMaterialData(material)


# Set the material properties
material.Type = IRobotMaterialType.I_MT_STEEL
material.E =  210000000000  # Young's modulus in Pascals
material.NU = 1 / 6       # Poisson's ratio
material.RO = 76900       # Unit weight in kg/m^3
material.Kirchoff = material.E / (2 * (1 + material.NU))

s=RobApp.Project.Structure.Labels.Store(a)
print(dir(s))




def myfunction(x):

    indexes = x
    
    
    
    section_names = [sections[i] for i in indexes]
    print("section_names", section_names)
    
    section_names = []
    
    for i, group in zip(indexes, groups):
        section_names.extend([sections[i]] * group)
    print("section_names", section_names)
    

    gr = [gr_list[i] for i in indexes]
    
    
    gr = []
    
    for i, group in zip(indexes, groups):
        gr.extend([gr_list[i]] * group)

    

    # Given data
    radius_of_gyration = gr # mm
    L = IN[4]  # mm
    E = 210000  # n/mm2
    Yield_stress = 240  # n/mm2
    
    slenderness = []
    final_stresses = []
    Cc = math.sqrt(2 * math.pi ** 2 * E / Yield_stress)
    
    
    for i in range(len(L)):
        slenderness_ratio = L[i] / radius_of_gyration[i]  # Calculate slenderness ratio
        slenderness.append(slenderness_ratio)
    
    for i, ratio in enumerate(slenderness):   
        if ratio > Cc:
            Pcr = math.pi ** 2 * E / ratio ** 2
            final_stresses.append(Pcr)
    
        else:
            Pc = Yield_stress * (1 - 0.5 * ratio ** 2 / Cc ** 2)
            final_stresses.append(Pc)
    
    
    
    
    
    
    
    # Assign each section from the list to the corresponding bar
    for i, section_name in enumerate(section_names, start=1):
        # Retrieve the bar using its index
        bar = RobApp.Project.Structure.Bars.Get(i)
        
        # Cast the bar to the IRobotBar type
        bar = IRobotBar(bar)
        
        # Set the section label to the bar
        bar.SetLabel(IRobotLabelType.I_LT_BAR_SECTION, section_name)
        bar.SetLabel(IRobotLabelType.I_LT_MATERIAL ,"120bar"  )
        bar.SetLabel(IRobotLabelType.I_LT_BAR_RELEASE ,"Pinned-Pinned"  )
    
    
    a=RobApp.Project.get_CalcEngine()
    b=IRobotCalcEngine(a)
    b.Calculate()
    
    
    
    #RESULTS
    serv= RobApp.Project.Structure.Results.Nodes.Displacements
    serb= RobApp.Project.Structure.Results.Bars.Stresses
    serr = RobApp.Project.Structure.Results.Nodes.Reactions
    
    
    
    reactions=[]
    for i in range(38, 50):  
        data=serr.Value(i,2)
        
        b=IRobotReactionData(data)
        res_uz = b.FZ
        reactions.append(res_uz)
    
    displacements=[]
    for i in range(1, 50):  
        data=serv.Value(i,1)
        
        b=IRobotDisplacementData(data)
        res_uz = b.UZ
        displacements.append(res_uz)
        
    
    stresses=[]
    for i in range(1, 121):  
        data=serb.Value(i,1,1)
        
        b=IRobotBarStressData(data)
        FXSX  = b.FXSX 
        stresses.append(FXSX)
    
    #Convert to mm
    displacements = [num *1000 for num in displacements]
    
    #Convert to N/mm²
    stresses = [num / 1000000 for num in stresses]
    
    #Convert to kg
    reactions = sum(reactions)/9.81
    
    
    Save=RobApp.Kernel
    b=IRobotKernel(Save)
    b.ProjectSaveAs(r'C:\Users\ugury\OneDrive\Masaüstü\New folder\1.rtd')
    
    
    #WEIGHT SCORE EVALUATION
    #Actual stress in the bar
    stress=stresses
    Displacement=displacements
    weight=reactions
    
    #Sets the scoring system for the stress ratios
    TensAllowableStress=172.37
    bucling=final_stresses
    AllowableDisplacement=50.8
    
    violation_coef=10
    
    tensstress=[]
    compstress=[]
    compindex=[]
    for index, value in enumerate(stress):
        if value < 0:
            compstress.append((value))
            compindex.append((index))
        else: 
            tensstress.append((value))    
    
    compstress=[abs(value) for value in compstress]
    
    CompAllowableStress=[bucling[index] for index in compindex]
    
    
    stress_ratio=[]
    violation = 0  # Initialize violation as a float or integer
    
    for i in tensstress:
        ratio = i / TensAllowableStress
        stress_ratio.append(ratio)
    
    
    for item1, item2 in zip(compstress, CompAllowableStress):
        ratio = item1 / item2
        stress_ratio.append(ratio)
    
    
    for d in Displacement:
        ratio = d / AllowableDisplacement
        stress_ratio.append(ratio)
    
    for r in stress_ratio:
        if r - 1 > 0:
            violation += r - 1
    
    weight_score=weight*(1+(violation*violation_coef))
    
    return weight_score


import numpy as np
x=[ 0, 21, 24,  1,  0, 25,  1]
x= [round(element) for element in x] 
weight_score= myfunction(x)  
resutl=np.array(weight_score)
print(resutl)
print("Execution time: {:.2f} seconds".format(time.time() - start_time))


sys.stdout.seek(0)
OUT = sys.stdout.read()
# ----------------------------------------
watch = Watch(structure_create_on_rsa_with)
discrete_optimization_with_ga = Python(IN[0]=sections, IN[1]=flatten_4, IN[2]=count, IN[3]=radius_of_gyration, IN[4]=code_block_15)  # CPython3
# ---------- discrete_optimization_with_ga.python (376 lines) ----------
import clr  # Required for Python for .NET
import sys
import random
import sys
import math
from io import StringIO
sys.stdout = StringIO()
clr.AddReference('ProtoGeometry')

from Autodesk.DesignScript.Geometry import *
import time
start_time = time.time()

# INPUTS

sections=IN[0]
bars=IN[1]
groups=IN[2]
gr_list=IN[3]



# Load the RSA API library
clr.AddReference(r'D:\Programs\Autodesk\Revit2024\Robot Structural Analysis Professional 2024\Exe\interop.RobotOM.dll')

# Import the RSA API
from RobotOM import *
from System import Object

RobApp= RobotApplicationClass()

## Dictionary to map unique nodes to their assigned IDs
unique_nodes = {}
next_node_id = 1  # Start with the first ID for nodes
next_bar_id = 1  # Start with the first ID for bars

def round_coords(x, y, z, precision=4):
    return (round(x, precision), round(y, precision), round(z, precision))

# Assign an ID to each unique node
for bar in bars:
    start_key = round_coords(bar.StartPoint.X, bar.StartPoint.Y, bar.StartPoint.Z)
    end_key = round_coords(bar.EndPoint.X, bar.EndPoint.Y, bar.EndPoint.Z)

    # If the start node is unique, assign an ID
    if start_key not in unique_nodes:
        unique_nodes[start_key] = next_node_id
        next_node_id += 1

    # If the end node is unique, assign an ID
    if end_key not in unique_nodes:
        unique_nodes[end_key] = next_node_id
        next_node_id += 1

# Now create nodes and bars in RSA
for bar in bars:
    start_key = round_coords(bar.StartPoint.X, bar.StartPoint.Y, bar.StartPoint.Z)
    end_key = round_coords(bar.EndPoint.X, bar.EndPoint.Y, bar.EndPoint.Z)

    # Retrieve the pre-assigned node IDs
    start_node_id = unique_nodes[start_key]
    end_node_id = unique_nodes[end_key]

    # Create the nodes with the assigned IDs
    RobApp.Project.Structure.Nodes.Create(start_node_id, *start_key)
    RobApp.Project.Structure.Nodes.Create(end_node_id, *end_key)

    # Create the bar between the nodes
    RobApp.Project.Structure.Bars.Create(next_bar_id, start_node_id, end_node_id)
    next_bar_id += 1  # Increment the bar ID for the next creation


support_list = [i for i in range(38, 50)]

for i in support_list:

    set_node1 = RobApp.Project.Structure.Nodes.Get(i)
    support1= IRobotNode(set_node1)
    support1.SetLabel(IRobotLabelType.I_LT_SUPPORT, "Pinned")
    
# Create a new simple case
case_number = RobApp.Project.Structure.Cases.FreeNumber
cas = RobApp.Project.Structure.Cases.CreateSimple(case_number,"Case_1", IRobotCaseNature.I_CN_PERMANENT , IRobotCaseAnalizeType.I_CAT_STATIC_LINEAR )

cas2 = RobApp.Project.Structure.Cases.CreateSimple(case_number+1,"Case_2", IRobotCaseNature.I_CN_PERMANENT , IRobotCaseAnalizeType.I_CAT_STATIC_LINEAR )



case1=cas.Records.Create(IRobotLoadRecordType.I_LRT_NODE_FORCE)
case2=cas2.Records.Create(IRobotLoadRecordType.I_LRT_DEAD)

# Point weight
load1=RobotLoadRecord(cas.Records.Create(IRobotLoadRecordType.I_LRT_NODE_FORCE))
load1.SetValue(IRobotNodeForceRecordValues.I_NFRV_FZ , -60000)
selection = load1.get_Objects()
a= IRobotSelection(selection)
a.FromText("1") 


load2=RobotLoadRecord(cas.Records.Create(IRobotLoadRecordType.I_LRT_NODE_FORCE))
load2.SetValue(IRobotNodeForceRecordValues.I_NFRV_FZ , -30000)
selection = load2.get_Objects()
b= IRobotSelection(selection)
b.FromText("2to13") 


load3=RobotLoadRecord(case1)
load3.SetValue(IRobotNodeForceRecordValues.I_NFRV_FZ , -10000)
selection = load3.get_Objects()
c= IRobotSelection(selection)
c.FromText("14to25") 



# Selfweight
case22=RobotLoadRecord(case2)
case22.SetValue(IRobotDeadRecordValues.I_DRV_Z,-1)
selection2 = case22.get_Objects()
b= IRobotSelection(selection2)
b.FromText("1to120") 


# Defining Material

# Define the material name
material_name = "120bar"


a=RobApp.Project.Structure.Labels
a=IRobotLabelServer(a)

a=a.Create(IRobotLabelType.I_LT_MATERIAL, material_name)

material = IRobotLabel(a).Data

material=IRobotMaterialData(material)


# Set the material properties
material.Type = IRobotMaterialType.I_MT_STEEL
material.E =  210000000000  # Young's modulus in Pascals
material.NU = 1 / 6       # Poisson's ratio
material.RO = 76900       # Unit weight in kg/m^3
material.Kirchoff = material.E / (2 * (1 + material.NU))

s=RobApp.Project.Structure.Labels.Store(a)





def myfunction(x):

    indexes = x
    
    
    
    section_names = [sections[i] for i in indexes]

    
    section_names = []
    
    for i, group in zip(indexes, groups):
        section_names.extend([sections[i]] * group)
 
    

    gr = [gr_list[i] for i in indexes]
    
    
    gr = []
    
    for i, group in zip(indexes, groups):
        gr.extend([gr_list[i]] * group)

    

    # Given data
    radius_of_gyration = gr # mm
    L = IN[4]  # mm
    E = 210000  # n/mm2
    Yield_stress = 240  # n/mm2
    
    slenderness = []
    final_stresses = []
    Cc = math.sqrt(2 * math.pi ** 2 * E / Yield_stress)
    
    
    for i in range(len(L)):
        slenderness_ratio = L[i] / radius_of_gyration[i]  # Calculate slenderness ratio
        slenderness.append(slenderness_ratio)
    
    for i, ratio in enumerate(slenderness):   
        if ratio > Cc:
            Pcr = math.pi ** 2 * E / ratio ** 2
            final_stresses.append(Pcr)
    
        else:
            Pc = Yield_stress * (1 - 0.5 * ratio ** 2 / Cc ** 2)
            final_stresses.append(Pc)
    
    
    
    
    
    
    
    # Assign each section from the list to the corresponding bar
    for i, section_name in enumerate(section_names, start=1):
        # Retrieve the bar using its index
        bar = RobApp.Project.Structure.Bars.Get(i)
        
        # Cast the bar to the IRobotBar type
        bar = IRobotBar(bar)
        
        # Set the section label to the bar
        bar.SetLabel(IRobotLabelType.I_LT_BAR_SECTION, section_name)
        bar.SetLabel(IRobotLabelType.I_LT_MATERIAL ,"120bar"  )
        bar.SetLabel(IRobotLabelType.I_LT_BAR_RELEASE ,"Pinned-Pinned"  )
    
    
    a=RobApp.Project.get_CalcEngine()
    b=IRobotCalcEngine(a)
    b.Calculate()
    
    
    
    #RESULTS
    serv= RobApp.Project.Structure.Results.Nodes.Displacements
    serb= RobApp.Project.Structure.Results.Bars.Stresses
    serr = RobApp.Project.Structure.Results.Nodes.Reactions
    
    
    
    reactions=[]
    for i in range(38, 50):  
        data=serr.Value(i,2)
        
        b=IRobotReactionData(data)
        res_uz = b.FZ
        reactions.append(res_uz)
    
    displacements=[]
    for i in range(1, 50):  
        data=serv.Value(i,1)
        
        b=IRobotDisplacementData(data)
        res_uz = b.UZ
        displacements.append(res_uz)
        
    
    stresses=[]
    for i in range(1, 121):  
        data=serb.Value(i,1,1)
        
        b=IRobotBarStressData(data)
        FXSX  = b.FXSX 
        stresses.append(FXSX)
    
    #Convert to mm
    displacements = [num *1000 for num in displacements]
    
    #Convert to N/mm²
    stresses = [num / 1000000 for num in stresses]
    
    #Convert to kg
    reactions = sum(reactions)/9.81
    
    
    Save=RobApp.Kernel
    b=IRobotKernel(Save)
    b.ProjectSaveAs(r'C:\Users\ugury\OneDrive\Masaüstü\New folder\1.rtd')
    
    
    #WEIGHT SCORE EVALUATION
    #Actual stress in the bar
    stress=stresses
    Displacement=displacements
    weight=reactions
    
    #Sets the scoring system for the stress ratios
    TensAllowableStress=240
    bucling=final_stresses
    AllowableDisplacement=10
    
    violation_coef=10
    
    tensstress=[]
    compstress=[]
    compindex=[]
    for index, value in enumerate(stress):
        if value < 0:
            compstress.append((value))
            compindex.append((index))
        else: 
            tensstress.append((value))    
    
    compstress=[abs(value) for value in compstress]
    
    CompAllowableStress=[bucling[index] for index in compindex]
    
    
    stress_ratio=[]
    violation = 0  # Initialize violation as a float or integer
    
    for i in tensstress:
        ratio = i / TensAllowableStress
        stress_ratio.append(ratio)
    
    
    for item1, item2 in zip(compstress, CompAllowableStress):
        ratio = item1 / item2
        stress_ratio.append(ratio)
    
    
    for d in Displacement:
        ratio = d / AllowableDisplacement
        stress_ratio.append(ratio)
    
    for r in stress_ratio:
        if r - 1 > 0:
            violation += r - 1
    
    weight_score=weight*(1+(violation*violation_coef))
    
    return weight_score




import numpy as np
from pymoo.algorithms.soo.nonconvex.ga import GA
from pymoo.core.problem import Problem
from pymoo.operators.crossover.sbx import SBX
from pymoo.operators.mutation.pm import PM
from pymoo.operators.repair.rounding import RoundingRepair
from pymoo.operators.sampling.rnd import IntegerRandomSampling
from pymoo.optimize import minimize
import logging



class Problem(Problem):
    def __init__(self):
        super().__init__(n_var=7, 
                         n_obj=1,
                         xl=np.array([0]*7),  
                         xu=np.array([26]*7),
                         vtype=int)
            

    def _evaluate(self, x, out, *args, **kwargs):
        x=x.tolist() 
        weight_score= [myfunction(sublist) for sublist in x]  
        resutl=np.array(weight_score)
        out["F"] = np.array(weight_score)


problem = Problem()

algorithm = GA(pop_size=20,
               sampling=IntegerRandomSampling(),
               crossover=SBX(prob=1.0, eta=3.0, vtype=float,repair=RoundingRepair()),
               mutation=PM(prob=1.0, eta=3.0, vtype=float,repair=RoundingRepair()),
               eliminate_duplicates=True)

res = minimize(problem, algorithm,('n_gen', 20),verbose=True)

print("Best solution found:")
print("Variables:", res.X)
print("Objectives:", res.F)
print("Constraints:", res.CV)
print("Optimization result:", res.algorithm.result)
print("Execution time: {:.2f} seconds".format(time.time() - start_time))
sys.stdout.seek(0)
OUT = sys.stdout.read()
# ----------------------------------------
watch_2 = Watch(discrete_optimization_with_ga)
