# Dynamo graph 36-Bar truss API and VP .dyn "36 API TEST" (Dynamo 2.17.0.3472)
# packages: BIM4Struc.Productivity 2.7.0

sections = CodeBlock()
# ---------- sections.designscript (25 lines) ----------
["RB 12",
"RB 11.9375",
"RB 11.875",
"RB 11.8125",
"RB 11.5625",
"RB 11.3125",
"RB 11",
"RB 10.75",
"RB 10.375",
"RB 10.125",
"RB 9.8125",
"RB 9.4375",
"RB 9.125",
"RB 8.75",
"RB 8.375",
"RB 8",
"RB 7.625",
"RB 7.125",
"RB 6.6875",
"RB 6.1875",
"RB 5.625",
"RB 5.0625",
"RB 4.375",
"RB 3.5625",
"RB 2.5625"];
# ----------------------------------------

# group: Dynamo Geometry for Truss
code_block = CodeBlock { 4.57; }
code_block_2 = CodeBlock { 7.92; }
starting_points_truss = CodeBlock(A=code_block, H=code_block_2, B=code_block) { p1=Point.ByCoordinates(0,0,0); p2=Point.ByCoordinates(0,-A,H); p3=Point.ByCoordinates(0,B,H); }
code_block_3 = CodeBlock { 27.42; }
code_block_4 = CodeBlock { 3; }
code_block_5 = CodeBlock(L=code_block_3, n=code_block_4) { PanelWidth=L/n; 0..L..PanelWidth; }
byCoordinates = Vector.ByCoordinates(x=code_block_5.out1)
add = Point.Add(point=starting_points_truss.p1, vectorToAdd=byCoordinates)
byPoints = PolyCurve.ByPoints(points=add)
curves = PolyCurve.Curves(polyCurve=byPoints)
explode = Geometry.Explode(geometry=curves)
flatten = List.Flatten(list=explode)
add_2 = Point.Add(point=starting_points_truss.p2, vectorToAdd=byCoordinates)
byCoordinates_2 = Vector.ByCoordinates()
add_3 = Point.Add(point=add_2, vectorToAdd=byCoordinates_2, lacing=Longest)
byPoints_2 = PolyCurve.ByPoints(points=add_3)
curves_2 = PolyCurve.Curves(polyCurve=byPoints_2)
explode_2 = Geometry.Explode(geometry=curves_2)
flatten_2 = List.Flatten(list=explode_2)
add_4 = Point.Add(point=starting_points_truss.p3, vectorToAdd=byCoordinates)
add_5 = Point.Add(point=add_4, vectorToAdd=byCoordinates_2, lacing=Longest)
byPoints_3 = PolyCurve.ByPoints(points=add_5)
curves_3 = PolyCurve.Curves(polyCurve=byPoints_3)
explode_3 = Geometry.Explode(geometry=curves_3)
flatten_3 = List.Flatten(list=explode_3)
byStartPointEndPoint = Line.ByStartPointEndPoint(startPoint=add, endPoint=add_3)
code_block_6 = CodeBlock { 0; }
removeItemAtIndex = List.RemoveItemAtIndex(list=byStartPointEndPoint, indices=code_block_6)
byStartPointEndPoint_2 = Line.ByStartPointEndPoint(startPoint=add, endPoint=add_5)
byStartPointEndPoint_3 = Line.ByStartPointEndPoint(startPoint=add_3, endPoint=add_5)
x_bracings = Custom[X bracings](PointsListCurve1=add_3, PointsListCurve2=add_5)  # package BIM4Struc.Productivity; Generate X bracing lines between two equal collections of points.
flatten_4 = List.Flatten(list=x_bracings)
x_bracings_2 = Custom[X bracings](PointsListCurve1=add, PointsListCurve2=add_3)
flatten_5 = List.Flatten(list=x_bracings_2)
x_bracings_3 = Custom[X bracings](PointsListCurve1=add, PointsListCurve2=add_5)
flatten_6 = List.Flatten(list=x_bracings_3)
code_block_7 = CodeBlock { [0,2,1]; }
code_block_8 = CodeBlock { [4,5,3]; }
code_block_9 = CodeBlock { [8,6,7]; }

removeItemAtIndex_2 = List.RemoveItemAtIndex(list=byStartPointEndPoint_2, indices=code_block_6)
removeItemAtIndex_3 = List.RemoveItemAtIndex(list=byStartPointEndPoint_3, indices=code_block_6)

# group (continued): Dynamo Geometry for Truss
list_create = List.Create(item0=flatten, item1=flatten_2, item2=flatten_3, item3=removeItemAtIndex, item4=removeItemAtIndex_2, item5=removeItemAtIndex_3, item6=flatten_4, item7=flatten_5, item8=flatten_6)
getItemAtIndex = List.GetItemAtIndex(list=list_create, index=code_block_7)
getItemAtIndex_2 = List.GetItemAtIndex(list=list_create, index=code_block_8)
getItemAtIndex_3 = List.GetItemAtIndex(list=list_create, index=code_block_9)
list_create_2 = List.Create(item0=getItemAtIndex, item1=getItemAtIndex_2, item2=getItemAtIndex_3)
flatten_7 = List.Flatten(list=list_create_2)

n36_bar_optimization_through_api = Python(IN[0]=sections, IN[1]=flatten_7)  # "36-bar optimization through API"; CPython3
# ---------- n36_bar_optimization_through_api.python (316 lines) ----------
import clr  # Required for Python for .NET
import sys
import random
import sys
from io import StringIO
sys.stdout = StringIO()
clr.AddReference('ProtoGeometry')

from Autodesk.DesignScript.Geometry import *

# INPUTS

sections=IN[0]
bars=IN[1]


# Load the RSA API library
clr.AddReference(r'D:\Programs\Autodesk\Revit2024\Robot Structural Analysis Professional 2024\Exe\interop.RobotOM.dll')

# Import the RSA API
from RobotOM import *
from System import Object

RobApp= RobotApplicationClass()

## Dictionary to map unique nodes to their assigned IDs
unique_nodes = {}
next_node_id = 1  # Start with the first ID for nodes
next_bar_id = 1  # Start with the first ID for bars

def round_coords(x, y, z, precision=4):
    return (round(x, precision), round(y, precision), round(z, precision))

# Assign an ID to each unique node
for bar in bars:
    start_key = round_coords(bar.StartPoint.X, bar.StartPoint.Y, bar.StartPoint.Z)
    end_key = round_coords(bar.EndPoint.X, bar.EndPoint.Y, bar.EndPoint.Z)

    # If the start node is unique, assign an ID
    if start_key not in unique_nodes:
        unique_nodes[start_key] = next_node_id
        next_node_id += 1

    # If the end node is unique, assign an ID
    if end_key not in unique_nodes:
        unique_nodes[end_key] = next_node_id
        next_node_id += 1

# Now create nodes and bars in RSA
for bar in bars:
    start_key = round_coords(bar.StartPoint.X, bar.StartPoint.Y, bar.StartPoint.Z)
    end_key = round_coords(bar.EndPoint.X, bar.EndPoint.Y, bar.EndPoint.Z)

    # Retrieve the pre-assigned node IDs
    start_node_id = unique_nodes[start_key]
    end_node_id = unique_nodes[end_key]

    # Create the nodes with the assigned IDs
    RobApp.Project.Structure.Nodes.Create(start_node_id, *start_key)
    RobApp.Project.Structure.Nodes.Create(end_node_id, *end_key)

    # Create the bar between the nodes
    RobApp.Project.Structure.Bars.Create(next_bar_id, start_node_id, end_node_id)
    next_bar_id += 1  # Increment the bar ID for the next creation



support_list = [1,9,5]

for i in support_list:

    set_node1 = RobApp.Project.Structure.Nodes.Get(i)
    support1= IRobotNode(set_node1)
    support1.SetLabel(IRobotLabelType.I_LT_SUPPORT, "Pinned")




# Create a new simple case
case_number = RobApp.Project.Structure.Cases.FreeNumber
cas = RobApp.Project.Structure.Cases.CreateSimple(case_number,"Case_1", IRobotCaseNature.I_CN_PERMANENT , IRobotCaseAnalizeType.I_CAT_STATIC_LINEAR )

cas2 = RobApp.Project.Structure.Cases.CreateSimple(case_number+1,"Case_2", IRobotCaseNature.I_CN_PERMANENT , IRobotCaseAnalizeType.I_CAT_STATIC_LINEAR )


case1=cas.Records.Create(IRobotLoadRecordType.I_LRT_NODE_FORCE)
case2=cas2.Records.Create(IRobotLoadRecordType.I_LRT_DEAD)

# Point weight
load1=RobotLoadRecord(cas.Records.Create(IRobotLoadRecordType.I_LRT_NODE_FORCE))
load1.SetValue(IRobotNodeForceRecordValues.I_NFRV_FZ , -444850)
selection = load1.get_Objects()
a= IRobotSelection(selection)
a.FromText("4") 


load2=RobotLoadRecord(cas.Records.Create(IRobotLoadRecordType.I_LRT_NODE_FORCE))
load2.SetValue(IRobotNodeForceRecordValues.I_NFRV_FY , 444850)
selection = load2.get_Objects()
b= IRobotSelection(selection)
b.FromText("4") 


# Selfweight
case22=RobotLoadRecord(case2)
case22.SetValue(IRobotDeadRecordValues.I_DRV_Z,-1)
selection2 = case22.get_Objects()
b= IRobotSelection(selection2)
b.FromText("1to36") 




# Define the material name
material_name = "36Bar"


a=RobApp.Project.Structure.Labels
a=IRobotLabelServer(a)

a=a.Create(IRobotLabelType.I_LT_MATERIAL, material_name)

material = IRobotLabel(a).Data

material=IRobotMaterialData(material)


# Set the material properties
material.Type = IRobotMaterialType.I_MT_STEEL
material.E = 68947573000  # Young's modulus in Pascals
material.NU = 0.28       # Poisson's ratio
material.RO = 27100       # Unit weight in kg/m^3
material.Kirchoff = material.E / (2 * (1 + material.NU))

s=RobApp.Project.Structure.Labels.Store(a)

def myfunction(x):

    indexes = x
    lst=indexes
    indexes=[lst[0:6],lst[3:6],lst[6:12],lst[6:9],lst[12:19],lst[18:20], lst[19:21],[lst[20]],lst[12:18]]
    indexes=[item for sublist in indexes for item in sublist]
    
    section_names = [sections[i] for i in indexes]

    
    # Assign each section from the list to the corresponding bar
    for i, section_name in enumerate(section_names, start=1):
        # Retrieve the bar using its index
        bar = RobApp.Project.Structure.Bars.Get(i)
        
        # Cast the bar to the IRobotBar type
        bar = IRobotBar(bar)
        
        # Set the section label to the bar
        bar.SetLabel(IRobotLabelType.I_LT_BAR_SECTION, section_name)
        bar.SetLabel(IRobotLabelType.I_LT_MATERIAL ,"36Bar"  )
        bar.SetLabel(IRobotLabelType.I_LT_BAR_RELEASE ,"Pinned-Pinned")
        
        
    a=RobApp.Project.get_CalcEngine()
    b=IRobotCalcEngine(a)
    b.Calculate()
    
    
    
    #RESULTS
    serv= RobApp.Project.Structure.Results.Nodes.Displacements
    serb= RobApp.Project.Structure.Results.Bars.Stresses
    serr = RobApp.Project.Structure.Results.Nodes.Reactions
    
    
    
    reactions=[]
    for i in [1,5,9]:  
        data=serr.Value(i,2)
        
        b=IRobotReactionData(data)
        res_uz = b.FZ
        reactions.append(res_uz)
    
    displacements=[]
    for i in range(1, 13):  
        data=serv.Value(i,1)
        
        b=IRobotDisplacementData(data)
        res_uz = b.UZ
        res_uy= b.UY
        displacements.append(res_uz)
        displacements.append(res_uy)
    
    stresses=[]
    for i in range(1, 37):  
        data=serb.Value(i,1,1)
        
        b=IRobotBarStressData(data)
        FXSX  = b.FXSX 
        stresses.append(FXSX)
    
    #Convert to mm
    displacements = [num *1000 for num in displacements]
    displacements=[abs(number) for number in displacements]


    
    #Convert to N/mm²
    stresses = [num / 1000000 for num in stresses]
    stresses=[abs(number) for number in stresses]
   
    #Convert to kg
    reactions = sum(reactions)/ 9.80665
  
    
    
    Save=RobApp.Kernel
    b=IRobotKernel(Save)
    b.ProjectSaveAs(r'C:\Users\ugury\OneDrive\Masaüstü\New folder\1.rtd')
    
    
    #WEIGHT SCORE EVALUATION
    #Actual stress in the bar
    stress=stresses
    Displacement=displacements
    weight=reactions
    
    #Sets the scoring system for the stress ratios
    TensAllowableStress=172.25
    CompAllowableStress=172.25
    AllowableDisplacement=50.8
    
    violation_coef=10
    
    tensstress=[]
    compstress=[]
    compindex=[]
    for index, value in enumerate(stress):
        if value < 0:
            compstress.append((value))
            compindex.append((index))
        else: 
            tensstress.append((value))    
    
    compstress=[abs(value) for value in compstress]
    
    Displacement=[abs(value) for value in Displacement]
    
    
    stress_ratio=[]
    violation = 0  # Initialize violation as a float or integer
    
    for i in tensstress:
        ratio = i / TensAllowableStress
        stress_ratio.append(ratio)
    
    
    for i in compstress:
        ratio = i / CompAllowableStress
        stress_ratio.append(ratio)
    
    
    for d in Displacement:
        ratio = d / AllowableDisplacement
        stress_ratio.append(ratio)
    
    for r in stress_ratio:
        if r - 1 > 0:
            violation += r - 1
    
    weight_score=weight*(1+(violation*violation_coef))

    return weight_score    




import numpy as np
from pymoo.algorithms.soo.nonconvex.ga import GA
from pymoo.algorithms.moo.nsga2 import NSGA2
from pymoo.core.problem import Problem
from pymoo.core.callback import Callback
from pymoo.optimize import minimize
import logging



class Problem(Problem):
    def __init__(self):
        super().__init__(n_var=21, 
                         n_obj=1,
                         xl=np.array([0]*21),  
                         xu=np.array([24]*21))
            

    def _evaluate(self, x, out, *args, **kwargs):
        x=x.tolist() 
        x= [[round(element) for element in sublist] for sublist in x]
        weight_score= [myfunction(sublist) for sublist in x]  
        resutl=np.array(weight_score)
        out["F"] = np.array(weight_score)


problem = Problem()

algorithm = GA(pop_size=40, eliminate_duplicates=True)

res = minimize(problem, algorithm,('n_gen', 40),verbose=True)

print("Best solution found:")
print("Variables:", res.X)
print("Objectives:", res.F)
print("Constraints:", res.CV)
print("Optimization result:", res.algorithm.result)


sys.stdout.seek(0)
OUT = sys.stdout.read()
# ----------------------------------------
watch = Watch(n36_bar_optimization_through_api)
